# Requirement set NGOs (R2024b)

## 1 [Structural Based Feasibility] To be able to be deployed in structures that sustain at least 20% of their original structure

### 1.1 [Lightweight and Quick to Deploy]

### 1.2 [Explore Hazardous Terrain]

### 1.3 [30 Second Deploy Time]

## 2 [Modularity] To support multiple playloads

### 2.1 [Support carriage for small to medium-sized items]

### 2.2 [Versatile Consolidated Actuation]

## 3 [Patient Care] To be able to detect and analyze patient status

### 3.1 [Assess Health of the Patient]

### 3.2 [Patient Comfort]

## 4 [S&R Assistance] To provide rapid aid and detailed analysis for S&R responders

### 4.1 [Low-cost]

### 4.2 [Localizations Technologies]

### 4.3 [Remote Visual Feedback]

### 4.4 [Measuring Environment Data]